# Grasshopper definition KarambaIDEA_Example_Truss.gh (Grasshopper 1.0.7)
# Copyright: B+G Engineers
# plug-ins: Karamba3D, KarambaIDEA

# ---- group: Parameters
# KarambaIDEA Example Truss
length = Slider(10, range=0..30)
structure_height = Slider(4, range=0..10)
truss_height = Slider(1, range=0..5)
truss_divisions = Slider(6, range=2..20)
connection_truss_column = ValueList({"Moment": 0, "Hinge": 1}, selected="Moment")

# ----
panel = Panel("""Parameters
Geometry
Karamba3D
0. Utilities
1. Load conversions
2. Create Project
3. Project utilities
4. Analytical templates
5. IDEA templates
6. IDEA utilities
7. Cost calculation""")
merge = Merge(
    Data1=ColourSwatch(SwatchColor=RGB(106, 144, 173)),
    Data2=ColourSwatch(SwatchColor=RGB(123, 189, 179)),
    Data3=ColourSwatch(SwatchColor=RGB(227, 136, 118)),
    Data4=ColourSwatch(SwatchColor=RGB(237, 201, 69)),
    Data5=ColourSwatch(SwatchColor=RGB(237, 201, 69)),
    Data6=ColourSwatch(SwatchColor=RGB(237, 221, 161)),
    Data7=ColourSwatch(SwatchColor=RGBA(212, 61, 66, 118)),
    Data8=ColourSwatch(SwatchColor=RGB(186, 222, 214)),
    Data9=ColourSwatch(SwatchColor=RGB(250, 227, 217)),
    Data10=ColourSwatch(SwatchColor=RGBA(255, 111, 15, 97)),
    Data11=ColourSwatch(SwatchColor=RGBA(86, 212, 61, 63)))
group_color = SliderGroupColor(run=Button(), groupNames=panel, colors=merge, defaultColor=ColourSwatch(SwatchColor=RGB(232, 227, 227)))  # inputs run: Boolean, groupNames: list of String, colors: list of Color, defaultColor: Color
# ---------- group_color: C# usings ----------
using System.Drawing;
using Grasshopper.Kernel.Special;
# ---------- group_color: C# ----------
    // Created by Timo Harboe Nielsen - Bjarke Ingels Group.
    
    if(!run){
      return;
    }
    GH_Document doc = owner.OnPingDocument();
    foreach (var dobj in doc.Objects)
    {
      GH_Group _group = dobj as GH_Group;
      if( _group == null){
        continue;
      }
      for(int i = 0; i < Math.Min(groupNames.Count, colors.Count); i++){
        string groupName = _group.NickName.ToString();
        string compareName = groupNames[i];
        if(groupName.IndexOf(compareName, StringComparison.OrdinalIgnoreCase) >= 0){
          _group.Colour = colors[i];
          break;
        } else{
          _group.Colour = defaultColor;
        }
      }
    }
# ---------- end group_color ----------

# ---- group: Geometry
X = UnitX(Factor=length)
pt = ConstructPoint(XCoordinate=0, YCoordinate=0, ZCoordinate=0)
move = Move(Geometry=pt, Motion=X)  # -> Geometry, Transform
pt_2 = Point(move.Geometry)
pt_3 = Point(pt)
ln = Line(StartPoint=pt, EndPoint=pt_2)
subtraction = Subtraction(A=structure_height, B=truss_height)
Z = UnitZ(Factor=structure_height)
Z_2 = UnitZ(Factor=subtraction)
divide = DivideCurve(Curve=ln, Count=truss_divisions, Kinks=False)  # -> Points, Tangents, Parameters
move_2 = Move(Geometry=divide.Points, Motion=Z_2)  # -> Geometry, Transform
move_3 = Move(Geometry=divide.Points, Motion=Z)  # -> Geometry, Transform
pt_4 = Point([pt_3, pt_2])
aligndim = AlignedDimension(Plane=PlaneXY(0, 0, 0), PointA=pt, PointB=pt_2, Offset=-1, Text="{0:0.00}", Size=0.2)

# ---- group: Karamba3D / Define Materials
matselect = MaterialSelectionKaramba3D(menu=[dropdown(1), dropdown(4)])

# ----
trusschords = Slider(50, range=0..100)
trussweb = Slider(9, range=0..100)

# ---- group: Karamba3D / Define Cross Sections
crosecrselect = CrossSectionRangeSelectorKaramba3D(MaximumHeight_cm=-1, MaximumWidth_cm=-1, Material=matselect, menu=[dropdown(1), dropdown(1), dropdown(4)])
panel_2 = Panel("50")
crosecselect = CrossSectionSelectorKaramba3D(CrossSections=crosecrselect, NameOrListIndexOfCrossSection="0")  # -> CrossSection, Info
crosecselect_2 = CrossSectionSelectorKaramba3D(CrossSections=crosecrselect, NameOrListIndexOfCrossSection="2")  # -> CrossSection, Info
crosecselect_3 = CrossSectionSelectorKaramba3D(CrossSections=crosecrselect, NameOrListIndexOfCrossSection="2")  # -> CrossSection, Info
entwine = Entwine(
    Branch00=crosecselect_3.CrossSection,
    Branch01=crosecselect_2.CrossSection,
    Branch02=crosecselect_2.CrossSection,
    Branch03=crosecselect.CrossSection,
    Branch04=crosecselect.CrossSection,
    FlattenInputs=True)
crosec = CrossSectionKaramba3D(crosecrselect)

# ---- group: Karamba3D / Define Loads
load_multiplier = Slider(20, range=0..500)
Z_3 = UnitZ(Factor=load_multiplier)
loads = LoadsKaramba3D(Vector=Z_3, BeamIdentifiers="Topchord", LCase="1", mode="Uniform Line", menu=[buttons(on, off, off)])

load_multiplier_2 = Slider(-50, range=-100..0)
Z_4 = UnitZ(Factor=load_multiplier_2)
loads_2 = LoadsKaramba3D(Vector=Z_4, BeamIdentifiers="Topchord", LCase="0", mode="Uniform Line", menu=[buttons(on, off, off)])

# ---- group: Karamba3D / Define Supports
panel_3 = Panel("Diagonal")
beam_joints = BeamJointsKaramba(
    ElementIdentifiers=panel_3,
    CtKNMAtStartingNode=Vector(0, 0, 0),
    CrKNmRadAtStartingNode=Vector(0, 0, 0),
    CtKNMAtEndNode=Vector(0, 0, 0),
    CrKNmRadAtEndNode=Vector(0, 0, 0),
    menu=[buttons(off, off, off, off, on, off), buttons(off, off, off, off, on, off)])

# ----
# Templates can be downloaded at:
# https://github.com/BouwenmetStaal/KarambaIDEA/tree/master/0_IDEA_Templates
panel_4 = Panel("C:\Users\r.ajouz\source\repos\KarambaIDEA\0_IDEA_Templates\")
concat = Concatenate(FragmentA=panel_4, FragmentB="Tjoint", FragmentC=".contemp")

# ----
# Templates can be downloaded at:
# https://github.com/BouwenmetStaal/KarambaIDEA/tree/master/0_IDEA_Templates
panel_5 = Panel("C:\Users\r.ajouz\source\repos\KarambaIDEA\0_IDEA_Templates\")
concat_2 = Concatenate(FragmentA=panel_5, FragmentB="trussCornerTemplate", FragmentC=".contemp")

panel_6 = Panel("113")
panel_7 = Panel("014")
panel_8 = Panel("1134")  # disabled
template_by_filepath = TemplateByFilepath()
create_idea_file = CreateIDEAFile()
calculate_idea_file = CalculateIDEAFile()  # -> Analysis, Plates, Bolts, Welds, Buckling, Summary
number_slider = Slider(8, range=0..10)
c_script = CSharpScript(x=number_slider, y=number_slider)  # -> out, A, B, C, D
# ---------- c_script: C# ----------
    var canvas_location = Grasshopper.Instances.ActiveCanvas.Viewport.ControlMidPoint;

    A = (int) canvas_location.X;
    B = (int) canvas_location.Y;

    C = Grasshopper.Instances.ActiveCanvas.Size;
    D = Grasshopper.Instances.ActiveCanvas.Viewport.Target;
# ---------- end c_script ----------
panel_9 = Panel(c_script.A)
panel_10 = Panel(c_script.B)
panel_11 = Panel(c_script.C)
panel_12 = Panel(c_script.D)
panel_13 = Panel(c_script.out)

# ---- group: Geometry
cluster = Cluster_2(pt=move_2.Geometry)
cluster_2 = Cluster_2(pt=move_3.Geometry)
pt_5 = Point(move_3.Geometry)
pt_6 = Point(move_2.Geometry)
int = Integer(connection_truss_column)
cluster_3 = Cluster(pt=move_2.Geometry)  # -> flatten(L)
cluster_4 = Cluster_3(pt=move_2.Geometry)
cluster_5 = Cluster(pt=move_3.Geometry)  # -> flatten(L)
pt_7 = Point(pt_4)
pt_8 = Point(cluster)
pt_9 = Point(cluster_2)
pt_10 = Point(pt_4)
ln_2 = Line(StartPoint=pt_5, EndPoint=pt_6)  # -> flatten(Line)
lng = ListLength(List=pt_5)
lng_2 = ListLength(List=pt_6)
lng_3 = ListLength(List=pt_5)
lng_4 = ListLength(List=pt_6)
cluster_6 = Cluster(pt=cluster_4)  # -> flatten(L)
entwine_2 = Entwine(Branch00=pt_9, Branch01=pt_8, Branch02=pt_10, FlattenInputs=True)
split = SplitList(List=pt_5, Index=expr("(x/2)", lng))  # -> ListA, ListB
split_2 = SplitList(List=pt_6, Index=expr("x/2", lng_2))  # -> ListA, ListB
split_3 = SplitList(List=pt_5, Index=expr("(x/2)-1", lng_3))  # -> ListA, ListB
split_4 = SplitList(List=pt_6, Index=expr("(x/2)-1", lng_4))  # -> ListA, ListB
flip = FlipMatrix(Data=entwine_2)
cull_i = CullIndex(List=ln_2, Indices="0", Wrap=True)
pt_11 = Point(split.ListA)
pt_12 = Point(split_2.ListA)
pt_13 = Point(split_3.ListB)
pt_14 = Point(split_4.ListB)
cluster_7 = Cluster(pt=flip)  # -> flatten(L)
lng_5 = ListLength(List=cull_i)
lng_6 = ListLength(List=pt_11)
lng_7 = ListLength(List=pt_14)
cull_i_2 = CullIndex(List=pt_12, Indices="0", Wrap=True)
culln = CullNth(List=cull_i, CullFrequency=lng_5)
cull_i_3 = CullIndex(List=pt_13, Indices="0", Wrap=True)
culln_2 = CullNth(List=pt_11, CullFrequency=lng_6)
culln_3 = CullNth(List=pt_14, CullFrequency=lng_7)
ln_3 = Line(StartPoint=culln_2, EndPoint=cull_i_2)  # -> flatten(Line)
ln_4 = Line(StartPoint=culln_3, EndPoint=cull_i_3)  # -> flatten(Line)
item = ListItem(List=ln_3, Index=0, Wrap=True)
item_2 = ListItem(List=ln_4, Index="-1", Wrap=True)
cull_i_4 = CullIndex(List=ln_3, Indices="0", Wrap=True)
cull_i_5 = CullIndex(List=ln_4, Indices="-1", Wrap=True)
pt_15 = Point(pt_7)
merge_2 = Merge(Data1=cluster_6, Data2=item, Data3=item_2)
merge_3 = Merge(Data1=ln_3, Data2=ln_4)
merge_4 = Merge(Data1=cull_i_4, Data2=cull_i_5)

# ----
line = Line(cluster_7)
line_2 = Line(cluster_5)
line_3 = Line(culln)
int_2 = Integer(int)

# ---- group: Geometry (continued)
filter = StreamFilter(Gate=int_2, Stream0=merge_3, Stream1=merge_4)
filter_2 = StreamFilter(Gate=int_2, Stream0=cluster_3, Stream1=merge_2)
entwine_3 = Entwine(Branch00=line, Branch01=line_2, Branch02=filter_2, Branch03=line_3, Branch04=filter, FlattenInputs=True)

# ----
pt_16 = Point(pt_15)
line_4 = Line(entwine_3)

# ---- group: Karamba3D
pt_17 = Point(pt_16)
line_5 = Line(line_4)
joint = JointKaramba3D(beam_joints)
load = LoadKaramba3D([loads_2, loads])

# ---- group: Karamba3D / Define Elements
panel_14 = Panel("""Column
Topchord
Bottomchord
Post
Diagonal""")
linetobeam = LineToBeamKaramba3D(Line=line_5, Identifier=graft(panel_14), CrossSection=entwine, New=True, Remove=True, LimitDistance_m=0.005)  # -> Element, Points, Info

# ---- group: Karamba3D / Define Supports
pt_18 = Point(pt_17)
supp = SupportKaramba(PosInd=pt_18, menu=[buttons(on, on, on, on, off, off)])

# ---- group: Karamba3D
load_2 = LoadKaramba3D(load)
element = ElementKaramba3D(linetobeam.Element)
support = SupportKaramba3D(supp)
joint_2 = JointKaramba3D(joint)

# ----
eccent_beam = EccentricityOnBeamKaramba3D(Beam=linetobeam.Element)

# ---- group: Karamba3D / Assemble Model
assemble = AssembleModelKaramba3D(Elem=flatten(element), Support=flatten(support), Load=flatten(load_2), Joint=flatten(joint_2), LimitDistance_m=0.005)  # -> Model, Info, Mass_kg, CenterOfGravity

# ---- group: Karamba3D / Optimize Crosssections
panel_15 = Panel("""Column
Topchord
Bottomchord
Post
Diagonal""")
crosec_2 = CrossSectionKaramba3D(crosec)
opticrosec = OptimizeCrossSectionKaramba3D(
    Model=assemble.Model,
    GroupIdentifiers=panel_15,
    CrossSections=crosec_2,
    MaximumUtilization=1,
    MaximumDisplacement_cm=-1,
    UltimateLimitStateIterations=5,
    DisplacementIterations=5,
    NumberOfSamplePoints=3,
    ElasticDesign=True,
    GammaM0=1,
    GammaM1=1)  # -> ModelWithOptimizedCrossSections, Info, Mass_kg, MaximumDisplacement_cm, ElasticEnergy_kNm

# ---- group: Karamba3D / Analyze Model
analyze = AnalyzeKaramba3D(Model=assemble.Model)  # -> CalculatedModel, MaximumDisplacement_cm, ResultingForceOfGravity_kN, ElasticEnergy_kNm

# ---- group: Karamba3D / View Results
modelview = ModelViewKaramba3D(Model=analyze.CalculatedModel, LoadCaseFactorsForLinearSuperposition=1, IndexOfVisibleLoadcase="0")  # -> Model, DeformedMesh, DeformedAxes, DeformedModel
beamview = BeamViewKaramba3D(Model=modelview.Model)  # -> Model, MeshesOfRenderedBeams, DeformedBeamAxes, LegendColors, LegendTags

# ---- group: 2. Create Project / Stream filter to control data speed
# KarambaIDEA
toggle = BooleanToggle(True)
filter_3 = StreamFilter(Gate=toggle, Stream1=beamview.Model)

# ---- group: 2. Create Project / Data collect
disassemble = DisassembleModelKaramba3D(Model=filter_3)  # -> Model, Point, Beam, Shell, Support, Load, Line, Mesh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
k3dbeamprops = CSharpScript(
    Model=disassemble.Model,
    Reference=["C:\PROGRAM FILES\RHINO 7\PLUG-INS\KARAMBA\karambaCommon.dll", "C:\Users\r.ajouz\AppData\Roaming\McNeel\Rhinoceros\packages\7.0\Karamba3D\2.2.0.8\karamba.gha"])  # -> BeamIds, Material, CrosecNames, CrosecShapes, Heights, Widths, TFlanges, TWebs, FRads
# ---------- k3dbeamprops: C# usings ----------
using Karamba.Elements;
using Karamba.CrossSections;
# ---------- k3dbeamprops: C# ----------
    var model = Model as Karamba.Models.Model;
    if (model == null) {
      throw new ArgumentException ("The input is not of type model!");
    }

    var beam_ids = new List<string>();
    var cs_names = new List<string>();
    var cs_shapes = new List<string>();
    var cs_material = new List<string>();
    var heights = new List<double>();
    var widths = new List<double>();
    var tflanges = new List<double>();
    var twebs = new List<double>();
    var frads = new List<double>();

    foreach (var elem in model.elems)
    {
      var beam = elem as ModelElementStraightLine;
      if (beam != null) {
        beam_ids.Add(elem.id);
        cs_names.Add(elem.crosec.name);
        cs_shapes.Add(elem.crosec.shape());
        cs_material.Add(elem.crosec.materialName);

        // is it an I-profile?
        var crosec_i = beam.crosec as CroSec_I;
        if (crosec_i != null) {
          heights.Add(crosec_i.getHeight() * 1000);
          // use the upper flange thickness
          widths.Add(crosec_i.uf_width * 1000);
          tflanges.Add(crosec_i.uf_thick * 1000);
          twebs.Add(crosec_i.w_thick * 1000);
          // use the inner fillet radius
          frads.Add(crosec_i.fillet_r * 1000);
          // this would be the outer fillet radius
          // frads.Add(crosec.fillet_r1);
          continue;
        }

        // is it a CHS?
        var crosec_o = beam.crosec as CroSec_Circle;
        if (crosec_o != null) {
          heights.Add(crosec_o.getHeight() * 1000);
          // use the upper flange thickness
          widths.Add(0);
          tflanges.Add(crosec_o.thick * 1000);
          twebs.Add(crosec_o.thick * 1000);
          frads.Add(0);
          continue;
        }

        // options for Box, trapezoid and T-section are not implemented yet
        throw new Exception("Cross section encountered for which no export is implemented");
      }
    }

    BeamIds = beam_ids;
    CrosecNames = cs_names;
    CrosecShapes = cs_shapes;
    Material = cs_material;
    Heights = heights;
    Widths = widths;
    TFlanges = tflanges;
    TWebs = twebs;
    FRads = frads;
# ---------- end k3dbeamprops ----------
b_forces = BeamForcesKaramba3D(AnalyzedModel=disassemble.Model, LCase=-1, MaximumDistanceBetweenResults_m=-1, NumberOfResultsPerBeamElement=2)  # -> AnalyzedModel, NormalForce_kN, ShearForceVz_kN, ShearForceVy_kN, BendingMomentMt_kNm, BendingMomentMy_kNm, BendingMomentMz_kNm
disassemble_2 = DisassembleElementKaramba3D(Element=disassemble.Beam)  # -> Element, ElementIdentifier, AxisOfElement, CrossSection, Joints, Material, LocalCoordinateSystem, ElementIsActive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
vec_cm_to_mm = Vector(expr("x*10", disassemble_2.LocalEccentricity_cm))
hierarchy = Panel("""Column
Topchord
Bottomchord
Post
Diagonal""")
cp = CreateProject(
    Hierarchy=hierarchy,
    Points=disassemble.Point,
    Lines=disassemble.Line,
    LCSRotations_Deg=disassemble_2.Alpha_deg,
    EccentricityVector=vec_cm_to_mm,
    Groupnames=k3dbeamprops.BeamIds,
    Materials=k3dbeamprops.Material,
    CrossSectionNames=k3dbeamprops.CrosecNames,
    Shapes=k3dbeamprops.CrosecShapes,
    Heights=k3dbeamprops.Heights,
    Widths=k3dbeamprops.Widths,
    ThicknessFlanges=k3dbeamprops.TFlanges,
    ThicknessWebs=k3dbeamprops.TWebs,
    Radius=k3dbeamprops.FRads,
    N=b_forces.NormalForce_kN,
    Vz=b_forces.ShearForceVz_kN,
    Vy=b_forces.ShearForceVy_kN,
    Mt=b_forces.BendingMomentMt_kNm,
    My=b_forces.BendingMomentMy_kNm,
    Mz=b_forces.BendingMomentMz_kNm)

# ----
data = Data(cp)
data_2 = Data(data)
data_3 = Data(data)

# ---- group: 3. Project utilities
# Visualize joints
visualize_joints = VisualizeJoints(Project=data_2)  # -> JointTypes, Brandnames, Centerpoints
radius = Slider(0.2, range=0.2..0.5)
move_along_x = Slider(27, range=0..100)
textsize = Slider(0.4, range=0..1)
spread = Slider(10, range=0..100)
cluster_8 = Cluster_5(line=visualize_joints.JointTypes, num_2=spread, num=move_along_x, num_3=radius)  # -> P, R
cluster_9 = Cluster_4(G=visualize_joints.Centerpoints, data_3=spread, X=move_along_x)
preview = CustomPreview(Geometry=cluster_8.P, Material=cluster_8.R)
xz = XZPlane(Origin=flatten(cluster_9))
data_4 = Data(flatten(visualize_joints.Brandnames))
tag = TextTag3D(Location=xz, Text=data_4, Size=textsize, Colour=ColourSwatch(SwatchColor=RGB(0, 0, 0)), Justification=7)

# ----
txt = Text(flatten(visualize_joints.Brandnames))  # disabled
tsort = SortText(Keys=txt, Culture=127)  # -> Keys, Values; disabled
dcon = DeleteConsecutive(Set=tsort.Keys, Wrap=False)  # -> Set, Count; disabled
panel_16 = Panel(dcon.Set)  # disabled

# ---- group: 5. IDEA Templates
template_by_filepath_2 = TemplateByFilepath(Project=data_3, TemplateFilePath=concat)  # -> Project, Message, Brep
preview_2 = CustomPreview(Geometry=template_by_filepath_2.Brep, Material=ColourSwatch(SwatchColor=RGB(63, 217, 209)))

# ----
at_wam = AnalyticalTemplateWeldsAllMembers(Project=data, BrandNames=panel_16)  # -> Project, Message, ThroatsBeginOfElement, ThroatsEndOfElement; disabled

# ---- group: 5. IDEA Templates
template_by_filepath_3 = TemplateByFilepath(Project=template_by_filepath_2.Project, TemplateFilePath=concat_2)  # -> Project, Message, Brep
preview_3 = CustomPreview(Geometry=template_by_filepath_3.Brep, Material=ColourSwatch(SwatchColor=RGB(217, 127, 63)))

# ----
template_weld_all_members = TemplateWeldAllMembers(Project=data_3, BrandNames=panel_8)  # -> Project, Message; disabled
template_weld_all_members_2 = TemplateWeldAllMembers(Project=at_wam.Project, BrandNames=panel_16)  # -> Project, Message; disabled
data_5 = Data(template_by_filepath_3.Project)

# ---- group: 6. IDEA utilities
number_slider_2 = Slider(0, range=0..30)
number_slider_3 = Slider(3, range=0..30)
data_6 = Data(data_5)
output_folderpath = Panel("C:\Data")
user_feedback = BooleanToggle(False)
run_all_joints = BooleanToggle(False)
run_idea = Button()
create_and_calculate_idea_file = CreateAndCalculateIDEAFile(
    Project=data_6,
    OutputFolder=output_folderpath,
    UserFeecback=user_feedback,
    RunAllJoints=run_all_joints,
    ChooseJoint=Slider(0, range=0..30),
    RunIDEA=run_idea)  # -> SelectedJoint, Analysis, Plates, Bolts, Welds, Buckling, Summary
rec = DataRecorder(create_and_calculate_idea_file.Analysis, DataLimit=-10, RecordData=True)
rec_2 = DataRecorder(create_and_calculate_idea_file.Plates, DataLimit=-10, RecordData=True)
rec_3 = DataRecorder(create_and_calculate_idea_file.Bolts, DataLimit=-10, RecordData=True)
rec_4 = DataRecorder(create_and_calculate_idea_file.Welds, DataLimit=-10, RecordData=True)
rec_5 = DataRecorder(create_and_calculate_idea_file.Buckling, DataLimit=-10, RecordData=True)
rec_6 = DataRecorder(create_and_calculate_idea_file.Summary, DataLimit=-10, RecordData=True)
# Calculate ideaCon file
summary_message = Panel(rec_6)
analysis = Panel(rec)
ucplates = Panel(rec_2)
ucbuckling = Panel(rec_5)
ucbolts = Panel(rec_3)
ucwelds = Panel(rec_4)

user_feedback_2 = BooleanToggle(False)
run_all_joints_2 = BooleanToggle(False)
run_idea_2 = Button()
data_7 = Data(data_5)
output_folderpath_2 = Panel("C:\Data")
create_idea_file_2 = CreateIDEAFile(
    Project=data_7,
    OutputFolder=output_folderpath_2,
    UserFeecback=user_feedback_2,
    CreateAllJoints=run_all_joints_2,
    ChooseJoint=Slider(0, range=0..30),
    RunIDEA=run_idea_2)  # -> SelectedJoint, FilePaths

# ----
rec_7 = DataRecorder(create_idea_file_2.FilePaths, DataLimit=-10, RecordData=True)
panel_17 = Panel(rec_7)

# ---- group: 3. Project utilities
# Local coordinate system
lcs = LocalCoordinateSystem(Project=data_2)  # -> LineOfElements, LocalXVectors, LocalYVectors, LocalZVectors
length_2 = Slider(0.149, range=0..2)
radius_2 = Slider(0.01, range=0..0.01)
curvepoint = PointOnCurve(lcs.LineOfElements, parameter=0.182)

# ----
cluster_10 = Cluster_6(num=length_2, num_2=radius_2, pt=curvepoint, vec_2=lcs.LocalXVectors, vec=lcs.LocalYVectors, vec_3=lcs.LocalZVectors)  # -> D, C

# ---- group: 3. Project utilities (continued)
preview_4 = CustomPreview(Geometry=cluster_10.D, Material=cluster_10.C)

# ==== cluster Cluster
pt = ClusterInput()

pt_2 = Point(pt)
lng = ListLength(List=pt_2)
cull_i = CullIndex(List=pt_2, Indices="0", Wrap=True)
culln = CullNth(List=pt_2, CullFrequency=lng)
ln = Line(StartPoint=culln, EndPoint=cull_i)

L = ClusterOutput(ln)

# ==== cluster Cluster_2
pt = ClusterInput()
pt_2 = Point(pt)
lng = ListLength(List=pt_2)
item = ListItem(List=pt_2, Index=expr("x-1", lng), Wrap=True)
item_2 = ListItem(List=pt_2, Index="0", Wrap=True)
merge = Merge(Data1=item_2, Data2=item)
R = ClusterOutput(merge)

# ==== cluster Cluster_3
pt = ClusterInput()
pt_2 = Point(pt)
cull_i = CullIndex(List=pt_2, Indices="0", Wrap=True)  # -> simplify(List)
lng = ListLength(List=cull_i)
culln = CullNth(List=cull_i, CullFrequency=lng)  # -> simplify(List)
L = ClusterOutput(culln)
panel = Panel(culln)

# ==== cluster Cluster_4
G = ClusterInput()
X = ClusterInput()
vec = VectorXYZ(XComponent=X, YComponent=0, ZComponent=0)  # -> Vector, Length
move = Move(Geometry=G, Motion=vec.Vector)  # -> Geometry, Transform
data = Data(move.Geometry)
tstat = TreeStatistics(Tree=data)  # -> Paths, Length, Count
dpath = DeconstructPath(Branch=tstat.Paths)
data_2 = Data(graft(tstat.Length))
flip = FlipMatrix(Data=dpath)
data_3 = ClusterInput()
bang = ExplodeTree(Data=flip)  # -> flatten(Branch0), flatten(Branch1)
data_4 = Data(data_3)
data_5 = Data(graft(bang.Branch0))
data_6 = Data(graft(bang.Branch1))
multiplication = Multiplication(A=bang.Branch0, B=data_4)
multiplication_2 = Multiplication(A=bang.Branch1, B=data_4)
path = ConstructPath(Indices=[data_5, data_6])  # -> flatten(Branch)
vec_2 = VectorXYZ(XComponent=multiplication, YComponent=multiplication_2, ZComponent=0)  # -> Vector, Length
unflatten = UnflattenTree(Tree=vec_2.Vector, Guide=path)  # -> graft(Tree)
data_7 = Data(flatten(data))
dup = DuplicateData(Data=unflatten, Number=data_2, Order=True)  # -> flatten(Data)
move_2 = Move(Geometry=data_7, Motion=dup)  # -> Geometry, Transform
G_2 = ClusterOutput(move_2.Geometry)
panel = Panel(move_2.Geometry)

# ==== cluster Cluster_5
num = ClusterInput()
num_2 = ClusterInput()
line = ClusterInput()
num_3 = ClusterInput()
num_4 = Number(num)
num_5 = Number(num_2)
line_2 = Line(line)
num_6 = Number(num_3)
cluster = Cluster_4(G=line_2, data_3=num_5, X=num_4)
line_3 = Line(cluster)
pipe = Pipe(Curve=line_3, Radius=num_6, Caps=0)  # -> flatten(Pipe)
dom = ConstructDomain(DomainStart="0", DomainEnd="1")
pshift = ShiftPaths(Data=line_2, Offset=-1)
P = ClusterOutput(pipe)
range = Range(Domain=dom, Steps=Slider(8, range=0..100))
lng = ListLength(List=pshift)
data = Data(flatten(lng))
data_2 = Data(range)
c_script = CSharpScript(lengths=data, colorlist=data_2)  # -> out, A; inputs lengths: list of Double, colorlist: list of Double
# ---------- c_script: C# ----------
    DataTree<double> tree = new DataTree<double>();
    GH_Path path = new GH_Path();
    int w = 0;


    for (int b = 0; b < lengths.Count; b++)
    {
      for (int c = 0;c < lengths[b];c++)
      {
        double num = colorlist[(w % colorlist.Count)];
        //tree.Add(num, path);
        tree.Add(num);
      }
      w = w + 1;

    }
    A = tree;
# ---------- end c_script ----------
data_3 = Data(flatten(c_script.A))
gradient = Gradient(
    LowerLimit=0,
    UpperLimit=1,
    Parameter=data_3,
    stops=[0: RGB(35, 99, 187), 0: RGB(234, 38, 0), 0: RGBA(255, 255, 255, 0), 0.25: RGB(234, 126, 0), 0.5: RGB(254, 244, 84), 0.75: RGB(173, 203, 249)])
lng_2 = ListLength(List=gradient)
dup = DuplicateData(Data=" (100)", Number=lng_2, Order=True)  # -> flatten(Data)
merge = Merge(Data1=graft(gradient), Data2=graft(dup))
join = TextJoin(Text=merge)  # -> flatten(Result)
R = ClusterOutput(join)

# ==== cluster Cluster_6
vec = ClusterInput()
vec_2 = ClusterInput()
pt = ClusterInput()
vec_3 = ClusterInput()
num = ClusterInput()
num_2 = ClusterInput()
vec_4 = Vector(vec)
vec_5 = Vector(vec_2)
pt_2 = Point(pt)
vec_6 = Vector(vec_3)
num_3 = Number(num)
num_4 = Number(num_2)
line = LineSDL(Start=pt_2, Direction=vec_5, Length=num_3)
line_2 = LineSDL(Start=pt_2, Direction=vec_4, Length=num_3)
line_3 = LineSDL(Start=pt_2, Direction=vec_6, Length=num_3)
panel = Panel("""255
0
0""")
entwine = Entwine(Branch00=line, Branch01=line_2, Branch02=line_3, FlattenInputs=True)  # -> simplify(Result)
panel_2 = Panel("""0
255
0""")
panel_3 = Panel("""0
0
255""")
rgb = ColourRGB(Alpha=255, Red=panel, Green=panel_2, Blue=panel_3)  # -> graft(Colour)
pipe = Pipe(Curve=entwine, Radius=num_4, Caps=0)
pshift = ShiftPaths(Data=pipe, Offset=-1)
C = ClusterOutput(rgb)
D = ClusterOutput(pshift)
