# Grasshopper definition KarambaIDEA_testfile.gh (Grasshopper 1.0.7)
# plug-ins: KarambaIDEA

pt = ConstructPoint(XCoordinate=0, YCoordinate=0, ZCoordinate=0)
X = UnitX(Factor=Slider(2, range=0..10))
move = Move(Geometry=pt, Motion=X)  # -> Geometry, Transform
ln = Line(StartPoint=pt, EndPoint=move.Geometry)
move_2 = Move(Geometry=move.Geometry, Motion=X)  # -> Geometry, Transform
ln_2 = Line(StartPoint=move.Geometry, EndPoint=move_2.Geometry)
number_slider = Slider(2, range=0..10)
dup = DuplicateData(Data="1", Number=number_slider, Order=True)
panel = Panel(["Columns", "Triangles"])
panel_2 = Panel(["Columns", "Triangles"])
line = Line([ln, ln_2])
lng = ListLength(List=line)
dup_2 = DuplicateData(Data=number_slider, Number=lng, Order=True)
dup_3 = DuplicateData(Data=dup, Number=lng, Order=True)
panel_3 = Panel(dup_3)
partition = PartitionList(List=panel_3, Size=dup_2)
dup_4 = DuplicateData(Data="CHS 42.4x3.2", Number=lng, Order=True)
dup_5 = DuplicateData(Data=Slider(0, range=0..1000), Number=lng, Order=True)
dup_6 = DuplicateData(Data="S355", Number=lng, Order=True)
dup_7 = DuplicateData(Data="O", Number=lng, Order=True)
dup_8 = DuplicateData(Data=Slider(42.4, range=0..100), Number=lng, Order=True)
dup_9 = DuplicateData(Data=Slider(3.2, range=0..10), Number=lng, Order=True)
dup_10 = DuplicateData(Data=Slider(0, range=0..1000), Number=lng, Order=True)
dup_11 = DuplicateData(Data=Slider(0, range=0..20), Number=lng, Order=True)
panel_4 = Panel(partition)
panel_5 = Panel(dup_4)
panel_6 = Panel(dup_6)
pt_2 = Point([pt, move.Geometry, move_2.Geometry])
panel_7 = Panel(dup_11)
panel_8 = Panel(dup_9)
panel_9 = Panel(dup_7)
panel_10 = Panel(dup_5)
panel_11 = Panel(dup_8)
panel_12 = Panel(dup_10)
cp = CreateProject(
    Hierarchy=panel_2,
    Points=pt_2,
    Lines=line,
    LCSRotations_Deg=panel_12,
    Groupnames=panel,
    Materials=panel_6,
    CrossSectionNames=panel_5,
    Shapes=panel_9,
    Heights=panel_11,
    Widths=panel_10,
    ThicknessFlanges=panel_8,
    ThicknessWebs=panel_8,
    Radius=panel_7,
    N=panel_4,
    Vz=panel_4,
    Vy=panel_4,
    Mt=panel_4,
    My=panel_4,
    Mz=panel_4)
template_weld_all_members = TemplateWeldAllMembers(Project=cp, BrandNames="0011")  # -> Project, Message
number_slider_2 = Slider(1, range=0..10)
create_and_calculate_idea_file = CreateAndCalculateIDEAFile(Project=template_weld_all_members.Project, OutputFolder="C:\Data", ChooseJoint=number_slider_2, RunIDEA=Button())  # -> SelectedJoint, Analysis, Plates, Bolts, Welds, Buckling, Summary
toggle = BooleanToggle(True)
create_idea_file = CreateIDEAFile(
    Project=template_weld_all_members.Project,
    OutputFolder="C:\Data",
    CreateAllJoints=Toggle(False),
    ChooseJoint=number_slider_2,
    RunIDEA=Button())
